# Grasshopper definition HW.gh (Grasshopper 1.0.7)
# plug-ins: NoiseWrapper, Noise 4D

number_slider = Slider(100, range=0..100)
timer = Timer(TimerInterval=10, Target=python_3)
timer_2 = Timer(TimerInterval=100, Target=python_2)
toggle = BooleanToggle(False)
nw = NoiseWrapper(Reset=True, Seed=209323094, Length=10, Width=Slider(70, range=0..100), Scale=0.1000000015)  # -> TextValues, Noise1D, Noise2D
msphere = MeshSphere(Base=PlaneXY(0, 0, 0), Radius=10, UCount=number_slider, VCount=number_slider)
python = GhPythonScript(N=Slider(28, range=0..100), R=Slider(14, range=0..100))  # -> out, points, count; inputs N: Int32
# ---------- python: Python ----------
import Rhino.Geometry as rg
import math
import rhinoscriptsyntax as rs

points = []
count = 0
for i in rs.frange(0,2*math.pi, math.pi/N):
    point = rg.Point3d(math.sin(i)*R, math.cos(i)*R,0)
    points.append(point)
    count += 1
# ---------- end python ----------
rectangle = Rectangle(Plane=PlaneXY(0, 0, 0), XSize="{-20,20}", YSize="{-20,20}", Radius=0)  # -> Rectangle, Length
python_2 = GhPythonScript(STATE=toggle, x=Slider(0.005, range=0.001..1))  # -> out, S
# ---------- python_2: Python ----------
import scriptcontext as sc

if not STATE:
    sc.sticky["s"] = 0.005
else:
    if S <= 1:
        sc.sticky["s"] += x
    
    
S = sc.sticky["s"]
# ---------- end python_2 ----------
python_3 = GhPythonScript(STATE=toggle, Start=Slider(0, range=0..100), Step=Slider(0.08, range=0..1))  # -> out, t
# ---------- python_3: Python ----------
import scriptcontext as sc

if not STATE:
    sc.sticky["t"] = Start
#    sc.sticky["s"] = 0.005
else:
    sc.sticky["t"] += Step
    
#   if S <= 1:
 #       sc.sticky["s"] += x
    
    
t = sc.sticky["t"]
#S = sc.sticky["s"]
# ---------- end python_3 ----------
demesh = DeconstructMesh(Mesh=msphere)  # -> Vertices, Faces, Colours, Normals
remap = RemapNumbers(Value=nw.Noise2D, Source="{0,80}", Target="{0,10}")  # -> Mapped, Clipped
divide = DivideCurve(Curve=rectangle.Rectangle, Count=python.count, Kinks=False)  # -> Points, Tangents, Parameters
simplex = SimplexNoise(Values=demesh.Vertices, Time=python_3.t, Scale=python_2.S)
series = Series(Start=0, Step=1, Count=python.count)
number_slider_2 = Slider(26, range=0..100)
number_slider_3 = Slider(14, range=0..100)
multiplication = Multiplication(A=number_slider_2, B=number_slider_3)
series_2 = Series(Start=0, Step=1, Count=python.count)
shift = ShiftList(List=divide.Points, Shift=Slider(36, range=0..100), Wrap=True)
multiplication_2 = Multiplication(A=simplex, B=Slider(10, range=0..10))
subtraction = Subtraction(A=multiplication, B=number_slider_3)
tag = TextTag3D(Location=python.points, Text=series, Size=1, Justification=7)
rev = ReverseList(List=shift)
python_4 = GhPythonScript(NOISES=remap.Mapped, N=number_slider_2, STEP=number_slider_3)  # -> out, points; inputs NOISES: list, N: Int32, STEP: Int32
# ---------- python_4: Python ----------
import Rhino.Geometry as rg
import random as rnd
import scriptcontext

points = []
rnd.seed(200)
k = 0

for i in range(N):
    for j in range (N):
        point = rg.Point3d(i*STEP, j*STEP, NOISES[k])
        points.append(point)
        k += 1
# ---------- end python_4 ----------
multiplication_3 = Multiplication(A=demesh.Normals, B=multiplication_2)
rectangle_2 = Rectangle(Plane=PlaneXY(0, 0, 0), XSize=subtraction, YSize=subtraction, Radius=0)  # -> Rectangle, Length
timer_3 = Timer(TimerInterval=1000, Target=python_5)
tag_2 = TextTag3D(Location=rev, Text=series_2, Size=1, Justification=7)
number_slider_4 = Slider(38, range=0..100)
gradient = Gradient(
    LowerLimit=0,
    UpperLimit=1,
    Parameter=simplex,
    stops=[0.0296: RGB(12, 7, 87), 0.278: RGB(255, 255, 255), 0.893: RGB(0, 119, 255)])
python_5 = GhPythonScript(STATE=Toggle(True), circ_pts=python.points, rect_pts=rev)  # -> out, s; inputs STATE: Boolean, circ_pts: list of Point3d, rect_pts: list of Point3d
# ---------- python_5: Python ----------
import Rhino.Geometry as rg
import scriptcontext as sc
import math

if not STATE:
    sc.sticky["t"] = 0.0
else:
    sc.sticky["t"] += 0.01
     
s = []
for i, pt in enumerate(circ_pts):
    rect_pts[i].Interpolate(pt, rect_pts[i], math.sin(sc.sticky["t"]))
    s.append(rect_pts[i])
# ---------- end python_5 ----------
move = Move(Geometry=demesh.Vertices, Motion=multiplication_3)  # -> Geometry, Transform
subtraction_2 = Subtraction(A=number_slider_2, B="1")
Z = UnitZ(Factor=Slider(8, range=0..20))
intcrv = Interpolate(Vertices=python_5.s, Degree=3, Periodic=True, KnotStyle=1)  # -> Curve, Length, Domain
sdivide = DivideSurface(Surface=rectangle_2.Rectangle, UCount=number_slider_4, VCount=number_slider_4)  # -> Points, Normals, Parameters
move_2 = Move(Geometry=python_4.points, Motion=Z)  # -> Geometry, Transform
boundary = BoundarySurfaces(Edges=rectangle_2.Rectangle)
Z_2 = UnitZ(Factor=Slider(43, range=0..50))
conmesh = ConstructMesh(Vertices=move.Geometry, Faces=demesh.Faces, Colours=gradient)
extr = Extrude(Base=boundary, Direction=Z_2)
srfgrid = SurfaceFromPoints(Points=move_2.Geometry, UCount=number_slider_2, Interpolate=True)
offset = OffsetCurve(Curve=intcrv.Curve, Distance=Slider(-4, range=-10..10), Plane=PlaneXY(0, 0, 0), Corners=1)
offset_2 = OffsetCurve(Curve=intcrv.Curve, Distance=Slider(4, range=0..10), Plane=PlaneXY(0, 0, 0), Corners=1)
offset_3 = OffsetCurve(Curve=intcrv.Curve, Distance=Slider(-2, range=-10..10), Plane=PlaneXY(0, 0, 0), Corners=1)
offset_4 = OffsetCurve(Curve=intcrv.Curve, Distance=Slider(2, range=0..10), Plane=PlaneXY(0, 0, 0), Corners=1)
pline = PolyLine(Vertices=sdivide.Parameters, Closed=False)
X = UnitX(Factor=Slider(6, range=0..10))
Z_3 = UnitZ(Factor=Slider(42, range=0..50))
extr_2 = Extrude(Base=srfgrid, Direction=Z_3)
extr_3 = Extrude(Base=pline, Direction=X)
Z_4 = UnitZ(Factor=Slider(50, range=0..50))
preview = CustomPreview(Geometry=[intcrv.Curve, offset_2, offset_4, offset_3, offset], Material=ColourSwatch(SwatchColor=RGB(4, 255, 0)))
sdiff = SolidDifference(BrepsA=extr, BrepsB=extr_2)
extr_4 = Extrude(Base=extr_3, Direction=Z_4)
sint = SolidIntersection(BrepsA=sdiff, BrepsB=extr_4)
preview_2 = CustomPreview(Geometry=sint, Material=ColourSwatch(SwatchColor=RGB(33, 182, 219)))
